# Grasshopper definition Image_To_Circle_Grid_00.gh (Grasshopper 1.0.7)
# plug-ins: LunchBox

crv = Curve([<curve referenced from the Rhino model> x2])
crv_2 = Curve(<curve referenced from the Rhino model>)
item = ListItem(List=crv, Index=0, Wrap=True)  # -> Item, Item1
swp2 = Sweep2(Rail1=item.Item, Rail2=item.Item1, Sections=crv_2, SameHeight=False)
grid = GridStructure(Surface=swp2, UDivisions=Slider(400, range=0..1000), VDivisions=Slider(350, range=0..1000))  # -> StructureLines, StructureNodes
cullpt = CullDuplicates(Points=grid.StructureNodes, Tolerance=0.1, CullMode=3)  # -> Points, Indices, Valence
srf_cp = SurfaceClosestPoint(Point=cullpt.Points, Surface=reparameterize(swp2))  # -> Point, simplify(UVPoint), Distance
image = ImageSampler(
    srf_cp.UVPoint,
    FilePath="C:\Users\Yuno\Downloads\ArchReactor.png",
    Filter="Value",
    Interpolate=False,
    Umax=1,
    Umin=0,
    Vmax=1,
    Vmin=0,
    Wrap=1)
number_slider = Slider(0.046, range=0..1)
dom = ConstructDomain(DomainStart=Slider(0, range=0..1), DomainEnd=Slider(0.065, range=0..1))
bnd = Bounds(Numbers=image)
remap = RemapNumbers(Value=image, Source=bnd, Target=dom)  # -> Mapped, Clipped
cir = Circle(Plane=cullpt.Points, Radius=remap.Mapped)
