# Grasshopper definition Construction_00.gh (Grasshopper 1.0.7)
# plug-ins: PTComponentLibrary

# ---- group: MAIN BOUNDS
crv = Curve(<curve referenced from the Rhino model>)

# ----
neg = Negative(Value=Slider(0.283, range=0..1))
rails = Curve([<curve referenced from the Rhino model> x2])

# ---- group: SECTIONS
crv_2 = Curve([<curve referenced from the Rhino model> x2])

# ----
item = ListItem(List=rails, Index=0, Wrap=True)  # -> Item, Item1
offset = OffsetCurve(Curve=crv, Distance=neg, Plane=PlaneXY(0, 0, 0), Corners=1)

# ---- group: VERTICALS
crv_3 = Curve([<curve referenced from the Rhino model> x3])

# ---- group: HORIZ
crv_4 = Curve([<curve referenced from the Rhino model> x2])

# ----
fillet = Fillet(Curve=offset, Radius=Slider(0.534, range=0..1))
fillet_2 = Fillet(Curve=crv, Radius=Slider(0.534, range=0..1))
swp2 = Sweep2(Rail1=item.Item, Rail2=item.Item1, Sections=crv_2, SameHeight=False)

# ---- group: LOGO CLEARING
crv_5 = Curve(<curve referenced from the Rhino model>)

# ----
ptsrfdomnum = SurfaceDomainNumber(Surface=swp2, UNumber=Slider(300, range=0..1000), VNumber=Slider(200, range=0..1000))  # -> simplify(Grid)
incurve = PointInCurve(Point=ptsrfdomnum, Curve=fillet)  # -> Relationship, Point
incurve_2 = PointInCurve(Point=ptsrfdomnum, Curve=crv_5)  # -> Relationship, Point
and = GateAnd(A=invert(incurve_2.Relationship), B=incurve.Relationship)
dispatch = Dispatch(List=ptsrfdomnum, DispatchPattern=and)  # -> ListA, ListB
or = GateOr(A=incurve_2.Relationship, B=incurve.Relationship)
pt = Point(dispatch.ListA)
crv_6 = Curve(<curve referenced from the Rhino model>)
srf = Surface(<surface referenced from the Rhino model>)
clean = CleanTree(RemoveNulls=True, RemoveInvalid=True, RemoveEmpty=False, Tree=pt)  # -> flatten(Tree)
crv_7 = Curve(<curve referenced from the Rhino model>)
pt_2 = Point(<point referenced from the Rhino model>)
dim = Dimensions(Surface=crv_6)  # -> UDimension, VDimension
srf_cp = SurfaceClosestPoint(Point=flatten(clean), Surface=reparameterize(srf))  # -> Point, UVPoint, Distance
image = ImageSampler(
    srf_cp.UVPoint,
    FilePath="C:\Users\Yuno\Documents\GitHub\BuildShare\Pattern_Maker\Demo_Picture.jpg",
    Filter="Value",
    Interpolate=False,
    Umax=1,
    Umin=0,
    Vmax=1,
    Vmin=0,
    Wrap=1)
dom = ConstructDomain(DomainStart=Slider(0.064, range=0..2), DomainEnd=Slider(0, range=0..2))
dom_2 = ConstructDomain(DomainStart=Slider(0, range=0..1), DomainEnd=Slider(1, range=0..1))
remap = RemapNumbers(Value=image, Source=dom_2, Target=dom)  # -> Mapped, Clipped
division = Division(A=remap.Mapped, B=dim.UDimension)
scale = Scale(Geometry=crv_7, Center=pt_2, Factor=division)  # -> Geometry, Transform
orient = Orient(Geometry=scale.Geometry, Source=pt_2, Target=clean)  # -> Geometry, Transform
