# Grasshopper definition WallPuzzleCNS.gh (Grasshopper 1.0.7)

bound_inset = Slider(0.41, range=0..1)
corner_fillet = Slider(0.75, range=0..5)

# ---- group: Composition Bounds
crv = Curve(<curve referenced from the Rhino model>)

# ----
dim = Dimensions(Surface=crv)  # -> UDimension, VDimension
explode = Explode(Curve=crv, Recursive=True)  # -> Segments, Vertices
panel = Panel("""0
3""")
item = ListItem(List=explode.Segments, Index=panel, Wrap=True)
item_2 = ListItem(List=item, Index=0, Wrap=True)  # -> Item, Item1

offset = OffsetCurve(Curve=crv, Distance=expr("-x", bound_inset), Plane=PlaneXY(0, 0, 0), Corners=1)
fillet = Fillet(Curve=offset, Radius=corner_fillet)

vertical_divides = Slider(5, range=0..10)
horizontal_divides = Slider(4, range=0..10)

# ---- group: Bound Curve
crv_2 = Curve(fillet)

# ---- group: Left Drive Crv
crv_3 = Curve(item_2.Item1)

# ---- group: Bottom Drive Crv
crv_4 = Curve(item_2.Item)

# ----
range = Range(Domain=Domain(0, 1), Steps=vertical_divides)
range_2 = Range(Domain=Domain(0, 1), Steps=horizontal_divides)
consec = ConsecutiveDomains(Numbers=range_2, Additive=False)
consec_2 = ConsecutiveDomains(Numbers=range, Additive=False)
swp1 = Sweep1(Rail=crv_4, Sections=crv_3, Miter=1)
dom² = ConstructDomain²(DomainU=consec_2, DomainV=graft(consec))
subsrf = Isotrim(Surface=reparameterize(swp1), Domain=dom²)  # -> simplify(Surface)

srf = Surface(subsrf)
outer_inner_separate = OuterInnerSeparate(srf=srf)  # -> srf_6, srf_7, srf_8

# ---- group: Outer Inner
srf_2 = Surface(simplify(outer_inner_separate.srf_7))

# ---- group: Corner
srf_3 = Surface(simplify(outer_inner_separate.srf_6))

# ---- group: Inner
srf_4 = Surface(simplify(outer_inner_separate.srf_8))

# ---- group: Connector Fillet Radius
number_slider = Slider(0.614, range=0..1)

# ---- group: Connector Dimension Dist
connect_dim = Slider(2.81, range=0..10)

# ---- group: ref curve pieces
crv_5 = Curve([<curve referenced from the Rhino model> x4])

# ----
cluster = Cluster(srf_3=srf_3, srf_2=srf_2, srf=srf_4, crv=crv_2)  # -> crv_4, crv_8, crv_10, crv_6, crv_12
edge_inner = Curve(cluster.crv_10)

# ---- group: Edge Outer
crv_6 = Curve(cluster.crv_6)

# ----
corner_edge = Curve(cluster.crv_8)

# ---- group: Corner Inner
crv_7 = Curve(cluster.crv_4)

# ----
division = Division(A=connect_dim, B=2)
fillet_2 = Fillet(Curve=crv_5, Radius=number_slider)

# ---- group: Inner Inner
crv_8 = Curve(cluster.crv_12)

# ----
end = EndPoints(Curve=crv_5)  # -> Start, End

# ---- group: Orientation line to absolute by sorting by x then y
explode_2 = Explode(Curve=crv_8, Recursive=True)  # -> Segments, Vertices
end_2 = EndPoints(Curve=explode_2.Segments)  # -> Start, End
curvepoint = PointOnCurve(explode_2.Segments, parameter=0.5)
merge = Merge(Data1=graft(end_2.Start), Data2=graft(end_2.End))
pdecon = Deconstruct(Point=merge)  # -> XComponent, YComponent, ZComponent
sort = SortList(Keys=pdecon.XComponent, ValuesA=merge)  # -> Keys, ValuesA
pdecon_2 = Deconstruct(Point=sort.ValuesA)  # -> XComponent, YComponent, ZComponent
sort_2 = SortList(Keys=pdecon_2.YComponent, ValuesA=sort.ValuesA)  # -> Keys, ValuesA
item_3 = ListItem(List=sort_2.ValuesA, Index=0, Wrap=True)  # -> Item, Item1
trim = TrimTree(Tree=item_3.Item, Depth=1)
trim_2 = TrimTree(Tree=item_3.Item1, Depth=1)
vec2pt = Vector2Pt(PointA=curvepoint, PointB=trim, Unitize=False)  # -> Vector, Length
vec2pt_2 = Vector2Pt(PointA=curvepoint, PointB=trim_2, Unitize=False)  # -> Vector, Length
amp = Amplitude(Vector=vec2pt.Vector, Amplitude=division)
amp_2 = Amplitude(Vector=vec2pt_2.Vector, Amplitude=division)
pdecon_3 = Deconstruct(Point=curvepoint)  # -> XComponent, YComponent, ZComponent
move = Move(Geometry=curvepoint, Motion=amp)  # -> Geometry, Transform
move_2 = Move(Geometry=curvepoint, Motion=amp_2)  # -> Geometry, Transform
addition = Addition(A=pdecon_3.XComponent, B=pdecon_3.YComponent, C=pdecon_3.ZComponent)

explode_3 = Explode(Curve=crv_7, Recursive=True)  # -> Segments, Vertices
end_3 = EndPoints(Curve=explode_3.Segments)  # -> Start, End
curvepoint_2 = PointOnCurve(explode_3.Segments, parameter=0.5)
merge_2 = Merge(Data1=graft(end_3.Start), Data2=graft(end_3.End))
pdecon_4 = Deconstruct(Point=merge_2)  # -> XComponent, YComponent, ZComponent
sort_3 = SortList(Keys=pdecon_4.XComponent, ValuesA=merge_2)  # -> Keys, ValuesA
pdecon_5 = Deconstruct(Point=sort_3.ValuesA)  # -> XComponent, YComponent, ZComponent
sort_4 = SortList(Keys=pdecon_5.YComponent, ValuesA=sort_3.ValuesA)  # -> Keys, ValuesA
item_4 = ListItem(List=sort_4.ValuesA, Index=0, Wrap=True)  # -> Item, Item1
trim_3 = TrimTree(Tree=item_4.Item, Depth=1)
trim_4 = TrimTree(Tree=item_4.Item1, Depth=1)
vec2pt_3 = Vector2Pt(PointA=curvepoint_2, PointB=trim_3, Unitize=False)  # -> Vector, Length
vec2pt_4 = Vector2Pt(PointA=curvepoint_2, PointB=trim_4, Unitize=False)  # -> Vector, Length
amp_3 = Amplitude(Vector=vec2pt_3.Vector, Amplitude=division)
amp_4 = Amplitude(Vector=vec2pt_4.Vector, Amplitude=division)
pdecon_6 = Deconstruct(Point=curvepoint_2)  # -> XComponent, YComponent, ZComponent
move_3 = Move(Geometry=curvepoint_2, Motion=amp_3)  # -> Geometry, Transform
move_4 = Move(Geometry=curvepoint_2, Motion=amp_4)  # -> Geometry, Transform
addition_2 = Addition(A=pdecon_6.XComponent, B=pdecon_6.YComponent, C=pdecon_6.ZComponent)

explode_4 = Explode(Curve=edge_inner, Recursive=True)  # -> Segments, Vertices
end_4 = EndPoints(Curve=explode_4.Segments)  # -> Start, End
curvepoint_3 = PointOnCurve(explode_4.Segments, parameter=0.5)
merge_3 = Merge(Data1=graft(end_4.Start), Data2=graft(end_4.End))
pdecon_7 = Deconstruct(Point=merge_3)  # -> XComponent, YComponent, ZComponent
sort_5 = SortList(Keys=pdecon_7.XComponent, ValuesA=merge_3)  # -> Keys, ValuesA
pdecon_8 = Deconstruct(Point=sort_5.ValuesA)  # -> XComponent, YComponent, ZComponent
sort_6 = SortList(Keys=pdecon_8.YComponent, ValuesA=sort_5.ValuesA)  # -> Keys, ValuesA
item_5 = ListItem(List=sort_6.ValuesA, Index=0, Wrap=True)  # -> Item, Item1
trim_5 = TrimTree(Tree=item_5.Item, Depth=1)
trim_6 = TrimTree(Tree=item_5.Item1, Depth=1)
vec2pt_5 = Vector2Pt(PointA=curvepoint_3, PointB=trim_5, Unitize=False)  # -> Vector, Length
vec2pt_6 = Vector2Pt(PointA=curvepoint_3, PointB=trim_6, Unitize=False)  # -> Vector, Length
amp_5 = Amplitude(Vector=vec2pt_5.Vector, Amplitude=division)
amp_6 = Amplitude(Vector=vec2pt_6.Vector, Amplitude=division)
pdecon_9 = Deconstruct(Point=curvepoint_3)  # -> XComponent, YComponent, ZComponent
move_5 = Move(Geometry=curvepoint_3, Motion=amp_5)  # -> Geometry, Transform
move_6 = Move(Geometry=curvepoint_3, Motion=amp_6)  # -> Geometry, Transform
addition_3 = Addition(A=pdecon_9.XComponent, B=pdecon_9.YComponent, C=pdecon_9.ZComponent)

# ----
ln = Line(StartPoint=end.Start, EndPoint=end.End)
lng = ListLength(List=crv_5)
curvepoint_4 = PointOnCurve(ln, parameter=0.5)
range_3 = Range(Domain=Domain(0, 1), Steps=lng)
xy = XYPlane(Origin=curvepoint_4)
consec_3 = ConsecutiveDomains(Numbers=range_3, Additive=False)

# ---- group: Position Based Connector Selection And Orienctation
random = Random(Range=Domain(0, 1), Number=1, Seed=addition_2)  # -> simplify(Random)
xy_2 = XYPlane(Origin=curvepoint_2)
trim_7 = TrimTree(Tree=random, Depth=1)
align = AlignPlane(Plane=xy_2, Direction=amp_4)  # -> Plane, Angle
fdom = FindDomain(Domains=consec_3, Number=trim_7, Strict=False)  # -> Index, Neighbour
pt = Point(flatten(move_3.Geometry))
pt_2 = Point(flatten(move_4.Geometry))
item_6 = ListItem(List=xy, Index=fdom.Index, Wrap=True)
item_7 = ListItem(List=fillet_2, Index=fdom.Index, Wrap=True)
end_5 = EndPoints(Curve=item_7)  # -> flatten(Start), flatten(End)
dist = Distance(PointA=end_5.Start, PointB=end_5.End)
dist_2 = Distance(PointA=pt, PointB=pt_2)
division_2 = Division(A=dist_2, B=dist)
orient = Orient(Geometry=item_7, Source=item_6, Target=align.Plane)  # -> Geometry, Transform
partition = PartitionList(List=division_2, Size="2")

random_2 = Random(Range=Domain(0, 1), Number=1, Seed=addition)  # -> simplify(Random)
xy_3 = XYPlane(Origin=curvepoint)
trim_8 = TrimTree(Tree=random_2, Depth=1)
align_2 = AlignPlane(Plane=xy_3, Direction=amp_2)  # -> Plane, Angle
fdom_2 = FindDomain(Domains=consec_3, Number=trim_8, Strict=False)  # -> Index, Neighbour
pt_3 = Point(flatten(move.Geometry))
pt_4 = Point(flatten(move_2.Geometry))
item_8 = ListItem(List=xy, Index=fdom_2.Index, Wrap=True)
item_9 = ListItem(List=fillet_2, Index=fdom_2.Index, Wrap=True)
end_6 = EndPoints(Curve=item_9)  # -> flatten(Start), flatten(End)
dist_3 = Distance(PointA=end_6.Start, PointB=end_6.End)
dist_4 = Distance(PointA=pt_3, PointB=pt_4)
division_3 = Division(A=dist_4, B=dist_3)
orient_2 = Orient(Geometry=item_9, Source=item_8, Target=align_2.Plane)  # -> Geometry, Transform
partition_2 = PartitionList(List=division_3, Size="4")

random_3 = Random(Range=Domain(0, 1), Number=1, Seed=addition_3)  # -> simplify(Random)
xy_4 = XYPlane(Origin=curvepoint_3)
trim_9 = TrimTree(Tree=random_3, Depth=1)
align_3 = AlignPlane(Plane=xy_4, Direction=amp_6)  # -> Plane, Angle
fdom_3 = FindDomain(Domains=consec_3, Number=trim_9, Strict=False)  # -> Index, Neighbour
pt_5 = Point(flatten(move_5.Geometry))
pt_6 = Point(flatten(move_6.Geometry))
item_10 = ListItem(List=xy, Index=fdom_3.Index, Wrap=True)
item_11 = ListItem(List=fillet_2, Index=fdom_3.Index, Wrap=True)
end_7 = EndPoints(Curve=item_11)  # -> flatten(Start), flatten(End)
dist_5 = Distance(PointA=end_7.Start, PointB=end_7.End)
dist_6 = Distance(PointA=pt_5, PointB=pt_6)
division_4 = Division(A=dist_6, B=dist_5)
orient_3 = Orient(Geometry=item_11, Source=item_10, Target=align_3.Plane)  # -> Geometry, Transform
partition_3 = PartitionList(List=division_4, Size="3")

# ----
scale = Scale(Geometry=simplify(orient_2.Geometry), Center=align_2.Plane, Factor=partition_2)  # -> Geometry, Transform
scale_2 = Scale(Geometry=simplify(orient.Geometry), Center=align.Plane, Factor=partition)  # -> Geometry, Transform
scale_3 = Scale(Geometry=simplify(orient_3.Geometry), Center=align_3.Plane, Factor=partition_3)  # -> Geometry, Transform

# ---- group: Rand Flip
random_4 = Random(Range=Domain(0, 1), Number=1, Seed=addition)
trim_10 = TrimTree(Tree=random_4, Depth=1)
larger = LargerThan(FirstNumber=trim_10, SecondNumber=0.5)  # -> LargerThan, OrEqualTo
dispatch = Dispatch(List=simplify(align_2.Plane), DispatchPattern=simplify(larger.LargerThan))  # -> ListA, ListB
dispatch_2 = Dispatch(List=simplify(scale.Geometry), DispatchPattern=simplify(larger.LargerThan))  # -> ListA, ListB
deplane = DeconstructPlane(Plane=dispatch.ListA)  # -> Origin, XAxis, YAxis, ZAxis
line = LineSDL(Start=deplane.Origin, Direction=deplane.XAxis, Length=1)
rotax = RotateAxis(Geometry=dispatch.ListA, Angle=1.570796327, Axis=line)  # -> Geometry, Transform
mirror = Mirror(Geometry=simplify(dispatch_2.ListA), Plane=simplify(rotax.Geometry))  # -> Geometry, Transform
weave = Weave(Pattern=larger.LargerThan, Stream0=dispatch_2.ListB, Stream1=mirror.Geometry, NullGaps=False)

random_5 = Random(Range=Domain(0, 1), Number=1, Seed=addition_2)
trim_11 = TrimTree(Tree=random_5, Depth=1)
larger_2 = LargerThan(FirstNumber=trim_11, SecondNumber=0.5)  # -> LargerThan, OrEqualTo
dispatch_3 = Dispatch(List=simplify(align.Plane), DispatchPattern=simplify(larger_2.LargerThan))  # -> ListA, ListB
dispatch_4 = Dispatch(List=simplify(scale_2.Geometry), DispatchPattern=simplify(larger_2.LargerThan))  # -> ListA, ListB
deplane_2 = DeconstructPlane(Plane=dispatch_3.ListA)  # -> Origin, XAxis, YAxis, ZAxis
line_2 = LineSDL(Start=deplane_2.Origin, Direction=deplane_2.XAxis, Length=1)
rotax_2 = RotateAxis(Geometry=dispatch_3.ListA, Angle=1.570796327, Axis=line_2)  # -> Geometry, Transform
mirror_2 = Mirror(Geometry=simplify(dispatch_4.ListA), Plane=simplify(rotax_2.Geometry))  # -> Geometry, Transform
weave_2 = Weave(Pattern=larger_2.LargerThan, Stream0=dispatch_4.ListB, Stream1=mirror_2.Geometry, NullGaps=False)

random_6 = Random(Range=Domain(0, 1), Number=1, Seed=addition_3)
trim_12 = TrimTree(Tree=random_6, Depth=1)
larger_3 = LargerThan(FirstNumber=trim_12, SecondNumber=0.5)  # -> LargerThan, OrEqualTo
dispatch_5 = Dispatch(List=simplify(align_3.Plane), DispatchPattern=simplify(larger_3.LargerThan))  # -> ListA, ListB
dispatch_6 = Dispatch(List=simplify(scale_3.Geometry), DispatchPattern=simplify(larger_3.LargerThan))  # -> ListA, ListB
deplane_3 = DeconstructPlane(Plane=dispatch_5.ListA)  # -> Origin, XAxis, YAxis, ZAxis
line_3 = LineSDL(Start=deplane_3.Origin, Direction=deplane_3.XAxis, Length=1)
rotax_3 = RotateAxis(Geometry=dispatch_5.ListA, Angle=1.570796327, Axis=line_3)  # -> Geometry, Transform
mirror_3 = Mirror(Geometry=simplify(dispatch_6.ListA), Plane=simplify(rotax_3.Geometry))  # -> Geometry, Transform
weave_3 = Weave(Pattern=larger_3.LargerThan, Stream0=dispatch_6.ListB, Stream1=mirror_3.Geometry, NullGaps=False)

# ---- group: Cull and Join
dom = ConstructDomain(DomainStart=expr("-x", division), DomainEnd=division)
ccx = CurveCurve(CurveA=crv_8, CurveB=simplify(weave))  # -> Points, ParamsA, ParamsB
rectangle = Rectangle(Plane=curvepoint, XSize=dom, YSize=dom, Radius=0)  # -> flatten(Rectangle), Length
trim_13 = TrimTree(Tree=ccx.ParamsA, Depth=1)
shatter = Shatter(Curve=crv_8, Parameters=trim_13)
curvepoint_5 = PointOnCurve(shatter, parameter=0.5)
incurve = PointInCurve(Point=graft(curvepoint_5), Curve=rectangle.Rectangle)  # -> simplify(Relationship), Point
ma = MassAddition(Input=incurve.Relationship)  # -> Result, PartialResults
larger_4 = LargerThan(FirstNumber=ma.Result, SecondNumber=0)  # -> LargerThan, OrEqualTo
trim_14 = TrimTree(Tree=larger_4.LargerThan, Depth=1)
dispatch_7 = Dispatch(List=shatter, DispatchPattern=trim_14)  # -> ListA, ListB
crv_9 = Curve(simplify(weave))
crv_10 = Curve(simplify(dispatch_7.ListB))
merge_4 = Merge(Data1=crv_10, Data2=crv_9)
join = JoinCurves(Curves=merge_4, Preserve=False)  # -> simplify(Curves)

dom_2 = ConstructDomain(DomainStart=expr("-x", division), DomainEnd=division)
ccx_2 = CurveCurve(CurveA=crv_7, CurveB=simplify(weave_2))  # -> Points, ParamsA, ParamsB
rectangle_2 = Rectangle(Plane=curvepoint_2, XSize=dom_2, YSize=dom_2, Radius=0)  # -> flatten(Rectangle), Length
trim_15 = TrimTree(Tree=ccx_2.ParamsA, Depth=1)
shatter_2 = Shatter(Curve=crv_7, Parameters=trim_15)
curvepoint_6 = PointOnCurve(shatter_2, parameter=0.5)
incurve_2 = PointInCurve(Point=graft(curvepoint_6), Curve=rectangle_2.Rectangle)  # -> simplify(Relationship), Point
ma_2 = MassAddition(Input=incurve_2.Relationship)  # -> Result, PartialResults
larger_5 = LargerThan(FirstNumber=ma_2.Result, SecondNumber=0)  # -> LargerThan, OrEqualTo
trim_16 = TrimTree(Tree=larger_5.LargerThan, Depth=1)
dispatch_8 = Dispatch(List=shatter_2, DispatchPattern=trim_16)  # -> ListA, ListB
crv_11 = Curve(simplify(weave_2))
crv_12 = Curve(simplify(dispatch_8.ListB))
corner_edge_2 = Curve(corner_edge)
merge_5 = Merge(Data1=crv_12, Data2=crv_11, Data3=corner_edge_2)
join_2 = JoinCurves(Curves=merge_5, Preserve=False)  # -> simplify(Curves)

dom_3 = ConstructDomain(DomainStart=expr("-x", division), DomainEnd=division)
ccx_3 = CurveCurve(CurveA=edge_inner, CurveB=simplify(weave_3))  # -> Points, ParamsA, ParamsB
rectangle_3 = Rectangle(Plane=curvepoint_3, XSize=dom_3, YSize=dom_3, Radius=0)  # -> flatten(Rectangle), Length
trim_17 = TrimTree(Tree=ccx_3.ParamsA, Depth=1)
shatter_3 = Shatter(Curve=edge_inner, Parameters=trim_17)
curvepoint_7 = PointOnCurve(shatter_3, parameter=0.5)
incurve_3 = PointInCurve(Point=graft(curvepoint_7), Curve=rectangle_3.Rectangle)  # -> simplify(Relationship), Point
ma_3 = MassAddition(Input=incurve_3.Relationship)  # -> Result, PartialResults
larger_6 = LargerThan(FirstNumber=ma_3.Result, SecondNumber=0)  # -> LargerThan, OrEqualTo
trim_18 = TrimTree(Tree=larger_6.LargerThan, Depth=1)
dispatch_9 = Dispatch(List=shatter_3, DispatchPattern=trim_18)  # -> ListA, ListB
crv_13 = Curve(simplify(weave_3))
crv_14 = Curve(simplify(dispatch_9.ListB))
corner_edge_3 = Curve(crv_6)
merge_6 = Merge(Data1=crv_14, Data2=crv_13, Data3=corner_edge_3)
join_3 = JoinCurves(Curves=merge_6, Preserve=False)  # -> simplify(Curves)

# ---- group: Joined Curve
crv_15 = Curve(join)

crv_16 = Curve(join_2)

crv_17 = Curve(join_3)

# ==== cluster OuterInnerSeparate
srf = ClusterInput()
srf_2 = Surface(srf)
flip = FlipMatrix(Data=srf_2)
tstat = TreeStatistics(Tree=simplify(srf_2))  # -> Paths, Length, Count
tstat_2 = TreeStatistics(Tree=simplify(flip))  # -> Paths, Length, Count
cull_i = CullIndex(List=tstat.Paths, Indices=0, Wrap=True)
item = ListItem(List=reverse(tstat.Paths), Index=0, Wrap=True)
item_2 = ListItem(List=reverse(tstat_2.Paths), Index=0, Wrap=True)
item_3 = ListItem(List=tstat_2.Paths, Index=0, Wrap=True)
item_4 = ListItem(List=tstat.Paths, Index=0, Wrap=True)
cull_i_2 = CullIndex(List=reverse(cull_i), Indices=0, Wrap=True)
branch = TreeBranch(Tree=flip, Path=item_3, MaintainPaths=True)
branch_2 = TreeBranch(Tree=flip, Path=item_2, MaintainPaths=True)
branch_3 = TreeBranch(Tree=srf_2, Path=item, MaintainPaths=True)
branch_4 = TreeBranch(Tree=srf_2, Path=item_4, MaintainPaths=True)
branch_5 = TreeBranch(Tree=srf_2, Path=cull_i_2, MaintainPaths=True)
cull_i_3 = CullIndex(List=branch, Indices=0, Wrap=True)
cull_i_4 = CullIndex(List=branch_2, Indices=0, Wrap=True)
cull_i_5 = CullIndex(List=branch_3, Indices=0, Wrap=True)
cull_i_6 = CullIndex(List=branch_4, Indices=0, Wrap=True)
flip_2 = FlipMatrix(Data=branch_5)
tstat_3 = TreeStatistics(Tree=simplify(flip_2))  # -> Paths, Length, Count
cull_i_7 = CullIndex(List=tstat_3.Paths, Indices=0, Wrap=True)
cull_i_8 = CullIndex(List=reverse(cull_i_7), Indices=0, Wrap=True)
branch_6 = TreeBranch(Tree=flip_2, Path=cull_i_8, MaintainPaths=True)
item_5 = ListItem(List=reverse(branch_4), Index=0, Wrap=True)
cull_i_9 = CullIndex(List=reverse(cull_i_3), Indices=0, Wrap=True)
item_6 = ListItem(List=branch_4, Index=0, Wrap=True)
item_7 = ListItem(List=branch_3, Index=0, Wrap=True)
cull_i_10 = CullIndex(List=reverse(cull_i_4), Indices=0, Wrap=True)
item_8 = ListItem(List=reverse(branch_3), Index=0, Wrap=True)
cull_i_11 = CullIndex(List=reverse(cull_i_5), Indices=0, Wrap=True)
cull_i_12 = CullIndex(List=reverse(cull_i_6), Indices=0, Wrap=True)
merge = Merge(Data1=item_6, Data2=item_5, Data3=item_7, Data4=item_8)
merge_2 = Merge(Data1=simplify(cull_i_12), Data2=simplify(cull_i_9), Data3=simplify(cull_i_10), Data4=simplify(cull_i_11))  # -> simplify(flatten(Result))
srf_3 = Surface(simplify(flatten(merge)))
srf_4 = Surface(simplify(flatten(branch_6)))
srf_5 = Surface(simplify(merge_2))
srf_6 = ClusterOutput(srf_3)
srf_7 = ClusterOutput(srf_5)
srf_8 = ClusterOutput(srf_4)

# ==== cluster Cluster
crv = ClusterInput()
srf = ClusterInput()
srf_2 = ClusterInput()
srf_3 = ClusterInput()

# ---- group: Outer Inner
srf_4 = Surface(simplify(srf_2))

# ---- group: Corner
srf_5 = Surface(simplify(srf_3))

# ---- group: Inner
srf_6 = Surface(simplify(srf))

# ---- group: Bound Curve
crv_2 = Curve(crv)

# ----
edges = BrepEdges(Brep=simplify(srf_5))  # -> Naked, Interior, NonManifold
project = Project(Curve=crv_2, Brep=srf_5, Direction=Vector(0, 0, 1))  # -> simplify(Curve)
edges_2 = BrepEdges(Brep=simplify(srf_4))  # -> Naked, Interior, NonManifold
project_2 = Project(Curve=crv_2, Brep=srf_4, Direction=Vector(0, 0, 1))  # -> simplify(Curve)
edges_3 = BrepEdges(Brep=simplify(srf_6))  # -> Naked, Interior, NonManifold
join = JoinCurves(Curves=edges.Naked, Preserve=False)  # -> simplify(Curves)
join_2 = JoinCurves(Curves=edges_2.Naked, Preserve=False)  # -> simplify(Curves)
ccx = CurveCurve(CurveA=crv_2, CurveB=join_2)  # -> Points, ParamsA, ParamsB
join_3 = JoinCurves(Curves=edges_3.Naked, Preserve=False)
ccx_2 = CurveCurve(CurveA=project, CurveB=join)  # -> Points, ParamsA, ParamsB
ccx_3 = CurveCurve(CurveA=crv_2, CurveB=join)  # -> Points, ParamsA, ParamsB
ccx_4 = CurveCurve(CurveA=project_2, CurveB=join_2)  # -> Points, ParamsA, ParamsB
shatter = Shatter(Curve=crv_2, Parameters=ccx.ParamsA)  # -> simplify(Segments)
shatter_2 = Shatter(Curve=join, Parameters=ccx_2.ParamsB)  # -> simplify(Segments)
shatter_3 = Shatter(Curve=crv_2, Parameters=ccx_3.ParamsA)  # -> simplify(Segments)
len = Length(Curve=shatter_2)
shatter_4 = Shatter(Curve=join_2, Parameters=ccx_4.ParamsB)  # -> simplify(Segments)
len_2 = Length(Curve=shatter_4)
len_3 = Length(Curve=shatter)
sort = SortList(Keys=len, ValuesA=shatter_2)  # -> Keys, ValuesA
len_4 = Length(Curve=shatter_3)
sort_2 = SortList(Keys=len_2, ValuesA=shatter_4)  # -> Keys, reverse(ValuesA)
item = ListItem(List=sort.ValuesA, Index=0, Wrap=True)
sort_3 = SortList(Keys=len_3, ValuesA=shatter)  # -> Keys, ValuesA
item_2 = ListItem(List=sort_2.ValuesA, Index=0, Wrap=True)
sort_4 = SortList(Keys=len_4, ValuesA=shatter_3)  # -> Keys, ValuesA
item_3 = ListItem(List=sort_3.ValuesA, Index=0, Wrap=True)
item_4 = ListItem(List=sort_4.ValuesA, Index=0, Wrap=True)
crv_3 = Curve(item)
crv_4 = ClusterOutput(crv_3)
crv_5 = Curve(item_3)
crv_6 = ClusterOutput(crv_5)
crv_7 = Curve(item_4)
crv_8 = ClusterOutput(crv_7)
crv_9 = Curve(item_2)
crv_10 = ClusterOutput(crv_9)
crv_11 = Curve(join_3)
crv_12 = ClusterOutput(crv_11)
